# Dynamo graph Random Single Story Building.dyn (Dynamo 2.1.0.6085)

number_slider = DoubleSlider(10.2, range=0..100 step 0.1)  # graph input
number_slider_2 = DoubleSlider(37.8, range=0..500 step 0.1)  # graph input
byCoordinates = Point.ByCoordinates(x=number_slider, y=number_slider_2)
number_slider_3 = DoubleSlider(20, range=0..3000 step 0.1)  # graph input
number_slider_4 = DoubleSlider(0, range=0..1000 step 0.1)  # graph input
byCoordinates_2 = Point.ByCoordinates(x=number_slider_3, y=number_slider_4)
number_slider_5 = DoubleSlider(0, range=0..100 step 0.1)  # graph input
number_slider_6 = DoubleSlider(0, range=0..500 step 0.1)  # graph input
byCoordinates_3 = Point.ByCoordinates(x=number_slider_5, y=number_slider_6)
number_slider_7 = DoubleSlider(0, range=0..100 step 0.1)  # graph input
number_slider_8 = DoubleSlider(25, range=0..500 step 0.1)  # graph input
byCoordinates_4 = Point.ByCoordinates(x=number_slider_7, y=number_slider_8)
create = List.Create(item0=byCoordinates, item1=byCoordinates_2, item2=byCoordinates_3, item3=byCoordinates_4)
boolean = BoolSelector(true)  # graph input
byPoints = PolyCurve.ByPoints(points=create, connectLastToFirst=boolean)
curves = PolyCurve.Curves(polyCurve=byPoints)
levels = Levels(index=0)  # graph input
levels_2 = Levels(index=1)  # graph input
wall_types = WallTypes(index=20)  # graph input
byCurveAndLevels = Wall.ByCurveAndLevels(c=curves, startLevel=levels, endLevel=levels_2, wallType=wall_types)
flatten = List.Flatten(list=curves)
code_block = CodeBlock { "Generic Roof - 300mm"; }
byName = RoofType.ByName(name=code_block)
levels_3 = Levels(index=1)  # graph input
byOutlineTypeAndLevel = Roof.ByOutlineTypeAndLevel(outline=flatten, roofType=byName, level=levels_3)
floor_types = FloorTypes(index=0)  # graph input
byOutlineTypeAndLevel_2 = Floor.ByOutlineTypeAndLevel(outline=flatten, floorType=floor_types, level=levels)
levels_4 = Levels(index=2)  # graph input
number = DoubleInput(1)
byCoordinates_5 = Vector.ByCoordinates(z=number)
byOriginNormal = Plane.ByOriginNormal(origin=byCoordinates, normal=byCoordinates_5)
number_2 = DoubleInput(0.01)
number_3 = DoubleInput(21.23)
byOutlineExtrusionTypeAndLevel = Roof.ByOutlineExtrusionTypeAndLevel(outline=flatten, roofType=byName, level=levels_4, plane=byOriginNormal, extrusionStart=number_2, extrusionEnd=number_3)
watch_3d = Watch3D(byOriginNormal)
